# Dynamo graph Nombres_Familia_EC02.dyn (Dynamo 3.7.0.11777)

categories = Categories("OST_StructuralColumns")
all_elements_of_category = ElementsOfCategory(Category=categories)
watch = Watch(all_elements_of_category)
python_script = Python(IN[0]=all_elements_of_category)  # CPython3
# ---------- python_script.python (54 lines) ----------
import clr

clr.AddReference("RevitAPI")
from Autodesk.Revit.DB import FamilyInstance

# Elementos recibidos desde All Elements of Category.
elementos = UnwrapElement(IN[0])

# Registrar cada familia una sola vez.
familias = {}

for elemento in elementos:
    if isinstance(elemento, FamilyInstance):
        familia = elemento.Symbol.Family
        id_familia = str(familia.Id.Value)

        if id_familia not in familias:
            familias[id_familia] = familia

# Encabezados del reporte.
reporte = [[
    "Id familia",
    "Categoria",
    "Nombre actual",
    "Nombre propuesto",
    "Estado"
]]

# Revisar las familias ordenadas por nombre.
for familia in sorted(
    familias.values(),
    key=lambda f: f.Name.lower()
):
    nombre = familia.Name
    tiene_espacios = " " in nombre

    nombre_propuesto = nombre.replace(" ", "_")
    estado = "NO CUMPLE" if tiene_espacios else "CUMPLE"

    categoria = familia.FamilyCategory
    nombre_categoria = (
        categoria.Name if categoria is not None
        else "Sin categoria"
    )

    reporte.append([
        str(familia.Id.Value),
        nombre_categoria,
        nombre,
        nombre_propuesto,
        estado
    ])

OUT = reporte
# ----------------------------------------
watch_2 = Watch(python_script)
code_block = CodeBlock { "G:/Mi unidad/01_Maestria BIM Management/CICLO 3/INTELIGENCIA ARTIFICIAL Y ANALISIS DE DATOS/EC2/Excel EC02/Reporte_Familias.xlsx"; }
code_block_2 = CodeBlock { "Revision_Familias"; }
code_block_3 = CodeBlock { 0; }
openXMLExportExcel = Data.OpenXMLExportExcel(filePath=code_block, sheetName=code_block_2, data=python_script, startRow=code_block_3, startColumn=code_block_3)
